# Grasshopper definition PI_RecreationModule_DesiredProcess.gh (Grasshopper 1.0.7)
# plug-ins: Human

window02 = GetNumber(Slider(65, range=10..80), AtLeast=1, AtMost=1, Maximum=80, Minimum=10, Prompt="Window Aperture 02")
module02 = GetNumber(Slider(3, range=1..5), AtLeast=1, AtMost=1, Maximum=5, Minimum=1, Prompt="Module 02")

module03 = GetNumber(Slider(4, range=1..5), AtLeast=1, AtMost=1, Maximum=5, Minimum=1, Prompt="Module 03")
window03 = GetNumber(Slider(38, range=10..80), AtLeast=1, AtMost=1, Maximum=80, Minimum=10, Prompt="Window Aperture 03")

basemodule = GetNumber(Slider(1, range=1..4), AtLeast=1, AtMost=1, Maximum=4, Minimum=1, Prompt="Base Module")
windowbm = GetNumber(Slider(62, range=10..80), AtLeast=1, AtMost=1, Maximum=80, Minimum=10, Prompt="Window Aperture BM")

scalemodule = GetNumber(Slider(40, range=1..48), AtLeast=1, AtMost=1, Maximum=48, Minimum=28, Prompt="People Inside")

subd = SubD(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)
unit_z = UnitZ(Factor=Slider(2.3, range=0..10))
move = Move(Geometry=subd, Motion=unit_z)  # -> Geometry, Transform
division = Division(A=window03, B=Slider(100, range=0..100))
division_2 = Division(A=window02, B=Slider(100, range=0..100))
brep = Brep(move.Geometry)
deconstruct_brep = DeconstructBrep(Brep=brep)  # -> Faces, Edges, Vertices
division_3 = Division(A=windowbm, B=Slider(100, range=0..100))
expression = Expression(x=scalemodule, Expression="if(x>12,2.00,1.00)")

# ---- group: BASE GEO
expression_2 = Expression(x=basemodule, Expression="if(x=4,48,0)")
expression_3 = Expression(x=basemodule, Expression="if(x=4,49,0)")
expression_4 = Expression(x=basemodule, Expression="if(x=4,50,0)")
expression_5 = Expression(x=basemodule, Expression="if(x=3,50,0)")
expression_6 = Expression(x=basemodule, Expression="if(x=3,49,0)")
expression_7 = Expression(x=basemodule, Expression="if(x=4,51,0)")
expression_8 = Expression(x=basemodule, Expression="if(x=1,50,0)")
expression_9 = Expression(x=basemodule, Expression="if(x=2,49,0)")
expression_10 = Expression(x=basemodule, Expression="if(x=3,51,0)")
expression_11 = Expression(x=basemodule, Expression="if(x=2,50,0)")
entwine = Entwine(
    Branch00=expression_8,
    Branch01=expression_9,
    Branch02=expression_11,
    Branch03=expression_6,
    Branch04=expression_5,
    Branch05=expression_10,
    Branch06=expression_3,
    Branch07=expression_2,
    Branch08=expression_4,
    Branch09=expression_7,
    FlattenInputs=True)
larger_than = LargerThan(FirstNumber=entwine, SecondNumber="0.99")  # -> LargerThan, OrEqualTo
dispatch = Dispatch(List=entwine, DispatchPattern=larger_than.LargerThan)  # -> ListA, ListB
number_slider = Slider(24, range=0..100)
number_slider_2 = Slider(48, range=0..100)
panel = Panel(dispatch.ListA)
absolute = Absolute(Value=panel)  # -> flatten(Result)
panel_2 = Panel(absolute)
panel_3 = Panel("""49
50
51""")

# ---- group: THIRD GEO
expression_12 = Expression(x=module03, Expression="if(x=4,48,0)")
expression_13 = Expression(x=module03, Expression="if(x=5,48,0)")
expression_14 = Expression(x=module03, Expression="if(x=4,49,0)")
expression_15 = Expression(x=module03, Expression="if(x=4,50,0)")
expression_16 = Expression(x=module03, Expression="if(x=5,49,0)")
expression_17 = Expression(x=module03, Expression="if(x=5,50,0)")
expression_18 = Expression(x=module03, Expression="if(x=3,50,0)")
expression_19 = Expression(x=module03, Expression="if(x=3,49,0)")
expression_20 = Expression(x=module03, Expression="if(x=4,51,0)")
expression_21 = Expression(x=module03, Expression="if(x=5,51,0)")
expression_22 = Expression(x=module03, Expression="if(x=1,50,0)")
expression_23 = Expression(x=module03, Expression="if(x=2,49,0)")
expression_24 = Expression(x=module03, Expression="if(x=3,51,0)")
expression_25 = Expression(x=module03, Expression="if(x=2,50,0)")
expression_26 = Expression(x=module03, Expression="if(x=5,52,0)")
entwine_2 = Entwine(
    Branch00=expression_22,
    Branch01=expression_23,
    Branch02=expression_25,
    Branch03=expression_19,
    Branch04=expression_18,
    Branch05=expression_24,
    Branch06=expression_14,
    Branch07=expression_12,
    Branch08=expression_15,
    Branch09=expression_20,
    Branch010=expression_16,
    Branch011=expression_13,
    Branch012=expression_17,
    Branch013=expression_21,
    Branch014=expression_26,
    FlattenInputs=True)
larger_than_2 = LargerThan(FirstNumber=entwine_2, SecondNumber="0.99")  # -> LargerThan, OrEqualTo
dispatch_2 = Dispatch(List=entwine_2, DispatchPattern=larger_than_2.LargerThan)  # -> ListA, ListB
number_slider_3 = Slider(24, range=0..100)
number_slider_4 = Slider(47, range=0..100)
panel_4 = Panel(dispatch_2.ListA)
absolute_2 = Absolute(Value=panel_4)  # -> flatten(Result)
panel_5 = Panel(absolute_2)

expression_27 = Expression(x=module02, Expression="if(x=4,48,0)")
expression_28 = Expression(x=module02, Expression="if(x=5,48,0)")
expression_29 = Expression(x=module02, Expression="if(x=4,49,0)")
expression_30 = Expression(x=module02, Expression="if(x=4,50,0)")
expression_31 = Expression(x=module02, Expression="if(x=5,49,0)")
expression_32 = Expression(x=module02, Expression="if(x=5,50,0)")
expression_33 = Expression(x=module02, Expression="if(x=3,50,0)")
expression_34 = Expression(x=module02, Expression="if(x=3,49,0)")
expression_35 = Expression(x=module02, Expression="if(x=4,51,0)")
expression_36 = Expression(x=module02, Expression="if(x=5,51,0)")
expression_37 = Expression(x=module02, Expression="if(x=1,50,0)")
expression_38 = Expression(x=module02, Expression="if(x=2,49,0)")
expression_39 = Expression(x=module02, Expression="if(x=3,51,0)")
expression_40 = Expression(x=module02, Expression="if(x=2,50,0)")
expression_41 = Expression(x=module02, Expression="if(x=5,52,0)")
entwine_3 = Entwine(
    Branch00=expression_37,
    Branch01=expression_38,
    Branch02=expression_40,
    Branch03=expression_34,
    Branch04=expression_33,
    Branch05=expression_39,
    Branch06=expression_29,
    Branch07=expression_27,
    Branch08=expression_30,
    Branch09=expression_35,
    Branch010=expression_31,
    Branch011=expression_28,
    Branch012=expression_32,
    Branch013=expression_36,
    Branch014=expression_41,
    FlattenInputs=True)
larger_than_3 = LargerThan(FirstNumber=entwine_3, SecondNumber="0.99")  # -> LargerThan, OrEqualTo
dispatch_3 = Dispatch(List=entwine_3, DispatchPattern=larger_than_3.LargerThan)  # -> ListA, ListB
number_slider_5 = Slider(24, range=0..100)
number_slider_6 = Slider(47, range=0..100)
panel_7 = Panel(dispatch_3.ListA)
absolute_3 = Absolute(Value=panel_7)  # -> flatten(Result)
panel_8 = Panel(absolute_3)

# ----
entwine_4 = Entwine(Branch00=expression, FlattenInputs=True)
panel_10 = Panel(entwine_4)
larger_than_4 = LargerThan(FirstNumber=panel_10, SecondNumber="0.99")  # -> LargerThan, OrEqualTo
expression_42 = Expression(x=scalemodule, Expression="if(x≥24,52,0)")
dispatch_4 = Dispatch(List=panel_10, DispatchPattern=larger_than_4.LargerThan)  # -> ListA, ListB
panel_11 = Panel(dispatch_4.ListA)
area = Area(Geometry=move.Geometry)  # -> Area, Centroid
absolute_4 = Absolute(Value=flatten(panel_11))
expression_43 = Expression(x=absolute_4, Expression="if(x=2,51,0)")
entwine_5 = Entwine(Branch00=expression_43, Branch01=expression_42, FlattenInputs=True)
panel_12 = Panel(entwine_5)
scale = Scale(Geometry=move.Geometry, Center=area.Centroid, Factor=absolute_4)  # -> Geometry, Transform
larger_than_5 = LargerThan(FirstNumber=panel_12, SecondNumber="1")  # -> LargerThan, OrEqualTo
dispatch_5 = Dispatch(List=panel_12, DispatchPattern=larger_than_5.LargerThan)  # -> ListA, ListB
deconstruct_brep_2 = DeconstructBrep(Brep=scale.Geometry)  # -> Faces, Edges, Vertices
panel_13 = Panel(dispatch_5.ListA)
cull_index = CullIndex(List=deconstruct_brep_2.Faces, Indices=flatten(panel_13), Wrap=True)

# ---- group: BASE GEO
number_slider_7 = Slider(51, range=0..100)
list_item = ListItem(List=cull_index, Index=absolute, Wrap=True)  # -> graft(Item)
curve = Curve(list_item)
join_curves = JoinCurves(Curves=curve, Preserve=False)
area_2 = Area(Geometry=list_item)  # -> Area, Centroid
scale_2 = Scale(Geometry=join_curves, Center=area_2.Centroid, Factor=division_3)  # -> Geometry, Transform
merge = Merge(Data1=join_curves, Data2=scale_2.Geometry)
loft = Loft(Curves=merge, Options={Adjust=False, Closed=False, LoftEnds=0, LoftSimp=0, LoftType=0, Rebuild=10, Refit=0.01})
area_3 = Area(Geometry=list_item)  # -> Area, Centroid
scale_3 = Scale(Geometry=loft, Center=area_2.Centroid, Factor=Slider(0.79, range=0..10))  # -> Geometry, Transform
deconstruct_brep_3 = DeconstructBrep(Brep=scale_3.Geometry)  # -> Faces, Edges, Vertices
scale_4 = Scale(Geometry=scale_3.Geometry, Center=area_3.Centroid, Factor=Slider(0.88, range=0..10))  # -> Geometry, Transform
list_item_2 = ListItem(List=deconstruct_brep_3.Faces, Index=0, Wrap=True)
list_item_3 = ListItem(List=deconstruct_brep_3.Faces, Index=Slider(1, range=0..10), Wrap=True)
number_slider_8 = Slider(2, range=0..10)
area_4 = Area(Geometry=list_item_3)  # -> Area, Centroid
area_5 = Area(Geometry=list_item_2)  # -> Area, Centroid
divide_surface = DivideSurface(Surface=flatten(list_item_2), UCount=number_slider_8, VCount=number_slider_8)  # -> Points, Normals, Parameters
line = Line(StartPoint=area_5.Centroid, EndPoint=area_4.Centroid)
brep_join = BrepJoin(Breps=[scale_3.Geometry, scale_4.Geometry, loft])  # -> Breps, Closed
project_point = ProjectPoint(Point=divide_surface.Points, Direction=line, Geometry=list_item_3)  # -> Point, Index
amplitude = Amplitude(Vector=line, Amplitude=Slider(0.11, range=0..10))
move_2 = Move(Geometry=divide_surface.Points, Motion=amplitude)  # -> Geometry, Transform
line_2 = Line(StartPoint=divide_surface.Points, EndPoint=move_2.Geometry)

# ----
explode_tree = ExplodeTree(Data=panel_13)  # -> Branch0, Branch1, Branch2, Branch3
list_item_4 = ListItem(List=deconstruct_brep_2.Faces, Index=flatten(explode_tree.Branch0), Wrap=True)
cull_index_2 = CullIndex(List=cull_index, Indices=absolute, Wrap=True)
list_item_5 = ListItem(List=deconstruct_brep_2.Faces, Index=flatten(explode_tree.Branch1), Wrap=True)
area_6 = Area(Geometry=move.Geometry)  # -> Area, Centroid
area_7 = Area(Geometry=list_item_4)  # -> Area, Centroid
area_8 = Area(Geometry=move.Geometry)  # -> Area, Centroid
area_9 = Area(Geometry=list_item_5)  # -> Area, Centroid
expression_44 = Expression(x=scalemodule, Expression="if(x>24,2.00,1.00)")
expression_45 = Expression(x=scalemodule, Expression="if(x>36,2.00,1.00)")
line_3 = Line(StartPoint=area_6.Centroid, EndPoint=area_7.Centroid)
amplitude_2 = Amplitude(Vector=line_3, Amplitude=Slider(10, range=0..10))
move_3 = Move(Geometry=move.Geometry, Motion=amplitude_2)  # -> Geometry, Transform
entwine_6 = Entwine(Branch00=expression_44, FlattenInputs=True)
entwine_7 = Entwine(Branch00=expression_45, FlattenInputs=True)
line_4 = Line(StartPoint=area_8.Centroid, EndPoint=area_9.Centroid)
panel_14 = Panel(entwine_6)
panel_15 = Panel(entwine_7)
amplitude_3 = Amplitude(Vector=line_4, Amplitude=Slider(8.9, range=0..10))
move_4 = Move(Geometry=move.Geometry, Motion=amplitude_3)  # -> Geometry, Transform
larger_than_6 = LargerThan(FirstNumber=panel_14, SecondNumber="0.99")  # -> LargerThan, OrEqualTo
larger_than_7 = LargerThan(FirstNumber=panel_15, SecondNumber="0.99")  # -> LargerThan, OrEqualTo
dispatch_6 = Dispatch(List=panel_14, DispatchPattern=larger_than_6.LargerThan)  # -> ListA, ListB
dispatch_7 = Dispatch(List=panel_15, DispatchPattern=larger_than_7.LargerThan)  # -> ListA, ListB
panel_16 = Panel(dispatch_6.ListA)
panel_17 = Panel(dispatch_7.ListA)
area_10 = Area(Geometry=move_3.Geometry)  # -> Area, Centroid
absolute_5 = Absolute(Value=flatten(panel_16))
expression_46 = Expression(x=absolute_5, Expression="if(x=2,50,0)")
expression_47 = Expression(x=absolute_5, Expression="if(x=1,50,0)")
area_11 = Area(Geometry=move_4.Geometry)  # -> Area, Centroid
entwine_8 = Entwine(Branch00=expression_47, Branch01=expression_46, FlattenInputs=True)
absolute_6 = Absolute(Value=flatten(panel_17))
expression_48 = Expression(x=absolute_6, Expression="if(x=2,53,0)")
expression_49 = Expression(x=absolute_6, Expression="if(x=1,53,0)")
scale_5 = Scale(Geometry=move_3.Geometry, Center=area_10.Centroid, Factor=absolute_5)  # -> Geometry, Transform
entwine_9 = Entwine(Branch00=expression_49, Branch01=expression_48, FlattenInputs=True)
panel_18 = Panel(entwine_8)
scale_6 = Scale(Geometry=move_4.Geometry, Center=area_11.Centroid, Factor=absolute_6)  # -> Geometry, Transform
panel_19 = Panel(entwine_9)
larger_than_8 = LargerThan(FirstNumber=panel_18, SecondNumber="1")  # -> LargerThan, OrEqualTo
larger_than_9 = LargerThan(FirstNumber=panel_19, SecondNumber="1")  # -> LargerThan, OrEqualTo
deconstruct_brep_4 = DeconstructBrep(Brep=scale_5.Geometry)  # -> Faces, Edges, Vertices
dispatch_8 = Dispatch(List=panel_18, DispatchPattern=larger_than_8.LargerThan)  # -> ListA, ListB
deconstruct_brep_5 = DeconstructBrep(Brep=scale_6.Geometry)  # -> Faces, Edges, Vertices
dispatch_9 = Dispatch(List=panel_19, DispatchPattern=larger_than_9.LargerThan)  # -> ListA, ListB
panel_20 = Panel(dispatch_8.ListA)
cull_index_3 = CullIndex(List=deconstruct_brep_4.Faces, Indices=flatten(panel_20), Wrap=True)

# ---- group: THIRD GEO
number_slider_9 = Slider(51, range=0..100)
number_slider_10 = Slider(1, range=0..1)
list_item_6 = ListItem(List=cull_index_3, Index=absolute_3, Wrap=True)  # -> graft(Item)
curve_2 = Curve(list_item_6)
divide_surface_2 = DivideSurface(Surface=list_item_6, UCount=number_slider_10, VCount=number_slider_10)  # -> flatten(Points), Normals, Parameters
join_curves_2 = JoinCurves(Curves=curve_2, Preserve=False)
evaluate_surface = EvaluateSurface(Surface=list_item_6, Point=divide_surface_2.Points)  # -> Point, Normal, UDirection, VDirection, Frame
number_slider_11 = Slider(0.1, range=0..0.1)
area_12 = Area(Geometry=list_item_6)  # -> Area, Centroid
scale_7 = Scale(Geometry=join_curves_2, Center=area_12.Centroid, Factor=division_2)  # -> Geometry, Transform
merge_2 = Merge(Data1=join_curves_2, Data2=scale_7.Geometry)
loft_2 = Loft(Curves=merge_2, Options={Adjust=False, Closed=False, LoftEnds=0, LoftSimp=0, LoftType=0, Rebuild=10, Refit=0.01})
area_13 = Area(Geometry=list_item_6)  # -> Area, Centroid
scale_8 = Scale(Geometry=loft_2, Center=area_12.Centroid, Factor=Slider(0.79, range=0..10))  # -> Geometry, Transform
deconstruct_brep_6 = DeconstructBrep(Brep=scale_8.Geometry)  # -> Faces, Edges, Vertices
scale_9 = Scale(Geometry=scale_8.Geometry, Center=area_13.Centroid, Factor=Slider(0.88, range=0..10))  # -> Geometry, Transform
list_item_7 = ListItem(List=deconstruct_brep_6.Faces, Index=0, Wrap=True)
list_item_8 = ListItem(List=deconstruct_brep_6.Faces, Index=Slider(1, range=0..10), Wrap=True)
number_slider_12 = Slider(2, range=0..10)
area_14 = Area(Geometry=list_item_8)  # -> Area, Centroid
area_15 = Area(Geometry=list_item_7)  # -> Area, Centroid
divide_surface_3 = DivideSurface(Surface=flatten(list_item_7), UCount=number_slider_12, VCount=number_slider_12)  # -> Points, Normals, Parameters
line_5 = Line(StartPoint=area_15.Centroid, EndPoint=area_14.Centroid)
brep_join_2 = BrepJoin(Breps=[scale_8.Geometry, scale_9.Geometry, loft_2])  # -> Breps, Closed
project_point_2 = ProjectPoint(Point=divide_surface_3.Points, Direction=line_5, Geometry=list_item_8)  # -> Point, Index
amplitude_4 = Amplitude(Vector=line_5, Amplitude=Slider(0.11, range=0..10))
move_5 = Move(Geometry=divide_surface_3.Points, Motion=amplitude_4)  # -> Geometry, Transform
line_6 = Line(StartPoint=divide_surface_3.Points, EndPoint=move_5.Geometry)

# ----
list_item_9 = ListItem(List=deconstruct_brep_4.Faces, Index=flatten(panel_20), Wrap=True)
panel_21 = Panel(dispatch_9.ListA)
cull_index_4 = CullIndex(List=cull_index_3, Indices=absolute_3, Wrap=True)
list_item_10 = ListItem(List=deconstruct_brep_5.Faces, Index=flatten(panel_21), Wrap=True)
cull_index_5 = CullIndex(List=deconstruct_brep_5.Faces, Indices=flatten(panel_21), Wrap=True)

# ---- group: THIRD GEO
number_slider_13 = Slider(51, range=0..100)
list_item_11 = ListItem(List=cull_index_5, Index=absolute_2, Wrap=True)  # -> graft(Item)
curve_3 = Curve(list_item_11)
join_curves_3 = JoinCurves(Curves=curve_3, Preserve=False)
number_slider_14 = Slider(0.1, range=0..0.1)
area_16 = Area(Geometry=list_item_11)  # -> Area, Centroid
scale_10 = Scale(Geometry=join_curves_3, Center=area_16.Centroid, Factor=division)  # -> Geometry, Transform
merge_3 = Merge(Data1=join_curves_3, Data2=scale_10.Geometry)
loft_3 = Loft(Curves=merge_3, Options={Adjust=False, Closed=False, LoftEnds=0, LoftSimp=0, LoftType=0, Rebuild=10, Refit=0.01})
area_17 = Area(Geometry=list_item_11)  # -> Area, Centroid
scale_11 = Scale(Geometry=loft_3, Center=area_16.Centroid, Factor=Slider(1.02, range=0..10))  # -> Geometry, Transform
deconstruct_brep_7 = DeconstructBrep(Brep=scale_11.Geometry)  # -> Faces, Edges, Vertices
scale_12 = Scale(Geometry=scale_11.Geometry, Center=area_17.Centroid, Factor=Slider(0.88, range=0..10))  # -> Geometry, Transform
list_item_12 = ListItem(List=deconstruct_brep_7.Faces, Index=0, Wrap=True)
list_item_13 = ListItem(List=deconstruct_brep_7.Faces, Index=Slider(1, range=0..10), Wrap=True)
number_slider_15 = Slider(2, range=0..10)
area_18 = Area(Geometry=list_item_13)  # -> Area, Centroid
area_19 = Area(Geometry=list_item_12)  # -> Area, Centroid
divide_surface_4 = DivideSurface(Surface=flatten(list_item_12), UCount=number_slider_15, VCount=number_slider_15)  # -> Points, Normals, Parameters
line_7 = Line(StartPoint=area_19.Centroid, EndPoint=area_18.Centroid)
brep_join_3 = BrepJoin(Breps=[scale_11.Geometry, scale_12.Geometry])  # -> Breps, Closed
project_point_3 = ProjectPoint(Point=divide_surface_4.Points, Direction=line_7, Geometry=list_item_13)  # -> Point, Index
amplitude_5 = Amplitude(Vector=line_7, Amplitude=Slider(0.11, range=0..10))
move_6 = Move(Geometry=divide_surface_4.Points, Motion=amplitude_5)  # -> Geometry, Transform
line_8 = Line(StartPoint=divide_surface_4.Points, EndPoint=move_6.Geometry)

# ----
curve_4 = Curve(list_item_4)
curve_5 = Curve(list_item_9)
explode = Explode(Curve=curve_4, Recursive=True)  # -> Segments, Vertices
explode_2 = Explode(Curve=curve_5, Recursive=True)  # -> Segments, Vertices
curve_middle = CurveMiddle(Curve=explode.Segments)
curve_middle_2 = CurveMiddle(Curve=explode_2.Segments)
interpolate = Interpolate(Vertices=curve_middle, Degree=3, Periodic=True, KnotStyle=1)  # -> Curve, Length, Domain
interpolate_2 = Interpolate(Vertices=curve_middle_2, Degree=3, Periodic=True, KnotStyle=1)  # -> Curve, Length, Domain
area_20 = Area(Geometry=interpolate_2.Curve)  # -> Area, Centroid
area_21 = Area(Geometry=interpolate.Curve)  # -> Area, Centroid
line_9 = Line(StartPoint=area_20.Centroid, EndPoint=area_21.Centroid)
pipe = Pipe(Curve=line_9, Radius=1, Caps=0)
pipe_2 = Pipe(Curve=[interpolate_2.Curve, interpolate.Curve], Radius=Slider(0.04, range=0..0.1), Caps=0)

cull_index_6 = CullIndex(List=cull_index_5, Indices=absolute_2, Wrap=True)

curve_6 = Curve(list_item_5)
curve_7 = Curve(list_item_10)
explode_3 = Explode(Curve=curve_6, Recursive=True)  # -> Segments, Vertices
explode_4 = Explode(Curve=curve_7, Recursive=True)  # -> Segments, Vertices
curve_middle_3 = CurveMiddle(Curve=explode_3.Segments)
curve_middle_4 = CurveMiddle(Curve=explode_4.Segments)
interpolate_3 = Interpolate(Vertices=curve_middle_3, Degree=3, Periodic=True, KnotStyle=1)  # -> Curve, Length, Domain
interpolate_4 = Interpolate(Vertices=curve_middle_4, Degree=3, Periodic=True, KnotStyle=1)  # -> Curve, Length, Domain
area_22 = Area(Geometry=interpolate_4.Curve)  # -> Area, Centroid
area_23 = Area(Geometry=interpolate_3.Curve)  # -> Area, Centroid
line_10 = Line(StartPoint=area_22.Centroid, EndPoint=area_23.Centroid)
pipe_3 = Pipe(Curve=line_10, Radius=1, Caps=0)
pipe_4 = Pipe(Curve=[interpolate_4.Curve, interpolate_3.Curve], Radius=Slider(0.04, range=0..0.1), Caps=0)

patch = Patch(Curves=[interpolate.Curve, interpolate_2.Curve], Spans=20, Flexibility=1, Trim=True)
patch_2 = Patch(Curves=[interpolate_3.Curve, interpolate_4.Curve], Spans=20, Flexibility=1, Trim=True)
colour_swatch = ColourSwatch(SwatchColor=RGB(110, 110, 110))
mesh = Mesh([pipe, pipe_2, patch])
mesh_2 = Mesh([pipe_3, pipe_4, patch_2])
mesh_colours = MeshColours(Mesh=mesh_2, Colours=colour_swatch)
mesh_colours_2 = MeshColours(Mesh=mesh, Colours=colour_swatch)
mesh_3 = Mesh(flatten(brep_join_3.Breps))
mesh_4 = Mesh(flatten(brep_join.Breps))
mesh_5 = Mesh(flatten(brep_join_2.Breps))
brep_join_4 = BrepJoin(Breps=cull_index_6)  # -> Breps, Closed
brep_join_5 = BrepJoin(Breps=cull_index_2)  # -> Breps, Closed
mesh_6 = Mesh(cull_index_6)
deconstruct_mesh = DeconstructMesh(Mesh=mesh_6)  # -> Vertices, Faces, Colours, Normals
point = Point(deconstruct_mesh.Vertices)
mesh_colours_3 = MeshColours(Mesh=mesh_6, Colours=ColourSwatch(SwatchColor=RGB(59, 125, 107)))
mesh_7 = Mesh(cull_index_2)
deconstruct_mesh_2 = DeconstructMesh(Mesh=mesh_7)  # -> Vertices, Faces, Colours, Normals
mesh_colours_4 = MeshColours(Mesh=mesh_7, Colours=ColourSwatch(SwatchColor=RGB(213, 247, 238)))
point_2 = Point(deconstruct_mesh_2.Vertices)
brep_join_6 = BrepJoin(Breps=cull_index_4)  # -> Breps, Closed
mesh_8 = Mesh(cull_index_4)
deconstruct_mesh_3 = DeconstructMesh(Mesh=mesh_8)  # -> Vertices, Faces, Colours, Normals
mesh_colours_5 = MeshColours(Mesh=mesh_8, Colours=ColourSwatch(SwatchColor=RGB(70, 94, 88)))
point_3 = Point(deconstruct_mesh_3.Vertices)
deconstruct = Deconstruct(Point=point_2)  # -> XComponent, YComponent, ZComponent
deconstruct_2 = Deconstruct(Point=point)  # -> XComponent, YComponent, ZComponent
deconstruct_3 = Deconstruct(Point=point_3)  # -> XComponent, YComponent, ZComponent
bounds = Bounds(Numbers=deconstruct.ZComponent)
bounds_2 = Bounds(Numbers=deconstruct_2.ZComponent)

dispanelsright = GetNumber(Slider(111, range=100..120), AtLeast=1, AtMost=1, Maximum=120, Minimum=100)
sedpanelsright = GetNumber(Slider(14, range=1..20), AtLeast=1, AtMost=1, Maximum=20, Minimum=1)

dispanels = GetNumber(Slider(103, range=100..120), AtLeast=1, AtMost=1, Maximum=120, Minimum=100)
sedpanels = GetNumber(Slider(11, range=1..20), AtLeast=1, AtMost=1, Maximum=20, Minimum=1)

bounds_3 = Bounds(Numbers=deconstruct_3.ZComponent)

dispanelscntr = GetNumber(Slider(120, range=100..120), AtLeast=1, AtMost=1, Maximum=120, Minimum=100)
sedpanelscntr = GetNumber(Slider(3, range=1..20), AtLeast=1, AtMost=1, Maximum=20, Minimum=1)

panelsonright = BooleanToggle(False)
panelsright = GetBoolean(panelsonright, AtLeast=1, AtMost=1, FalseValue="False", TrueValue="True")

panelson = BooleanToggle(False)
panels = GetBoolean(panelson, AtLeast=1, AtMost=1, FalseValue="False", TrueValue="True")

panelsonright_2 = BooleanToggle(False)
panelscntr = GetBoolean(panelsonright_2, AtLeast=1, AtMost=1, FalseValue="False", TrueValue="True")

deconstruct_domain = DeconstructDomain(Domain=bounds)  # -> Start, End
deconstruct_domain_2 = DeconstructDomain(Domain=bounds_2)  # -> Start, End
deconstruct_domain_3 = DeconstructDomain(Domain=bounds_3)  # -> Start, End
colour_swatch_2 = ColourSwatch(SwatchColor=RGB(194, 194, 194))
mesh_colours_6 = MeshColours(Mesh=mesh_3, Colours=colour_swatch_2)
mesh_colours_7 = MeshColours(Mesh=mesh_5, Colours=colour_swatch_2)
mesh_colours_8 = MeshColours(Mesh=mesh_4, Colours=colour_swatch_2)
gradient = Gradient(
    LowerLimit=deconstruct_domain_2.Start,
    UpperLimit=deconstruct_domain_2.End,
    Parameter=deconstruct_2.ZComponent,
    stops=[0.145: RGB(47, 79, 79), 0.38: RGB(0, 139, 139), 0.622: RGB(95, 158, 160), 0.797: RGB(173, 216, 230), 1: RGB(240, 255, 255)])
gradient_2 = Gradient(
    LowerLimit=deconstruct_domain.Start,
    UpperLimit=deconstruct_domain.End,
    Parameter=deconstruct.ZComponent,
    stops=[0.0511: RGB(47, 79, 79), 0.183: RGB(0, 139, 139), 0.508: RGB(95, 158, 160), 0.621: RGB(173, 216, 230), 1: RGB(240, 255, 255)])
gradient_3 = Gradient(
    LowerLimit=deconstruct_domain_3.Start,
    UpperLimit=deconstruct_domain_3.End,
    Parameter=deconstruct_3.ZComponent,
    stops=[0.28: RGB(47, 79, 79), 0.572: RGB(0, 139, 139), 0.723: RGB(95, 158, 160), 0.905: RGB(173, 216, 230), 1: RGB(240, 255, 255)])
brep_edges = BrepEdges(Brep=cull_index_4)  # -> Naked, Interior, NonManifold
brep_edges_2 = BrepEdges(Brep=cull_index_6)  # -> Naked, Interior, NonManifold
brep_edges_3 = BrepEdges(Brep=cull_index_2)  # -> Naked, Interior, NonManifold
cluster = Cluster(A=dispanelsright, steps=sedpanelsright, stream=mesh_6, gate=panelsright, geometry=brep_join_4.Breps)  # -> geometry_2, line_2, geometry_3
construct_mesh = ConstructMesh(Vertices=deconstruct_mesh.Vertices, Faces=deconstruct_mesh.Faces, Colours=gradient)  # -> flatten(Mesh)
cluster_2 = Cluster(A=dispanels, steps=sedpanels, stream=mesh_8, gate=panels, geometry=brep_join_6.Breps)  # -> geometry_2, line_2, geometry_3
cluster_3 = Cluster(A=dispanelscntr, steps=sedpanelscntr, stream=mesh_7, gate=panelscntr, geometry=brep_join_5.Breps)  # -> geometry_2, line_2, geometry_3
pipe_5 = Pipe(Curve=brep_edges.Naked, Radius=Slider(0.05, range=0..0.1), Caps=0)
construct_mesh_2 = ConstructMesh(Vertices=deconstruct_mesh_2.Vertices, Faces=deconstruct_mesh_2.Faces, Colours=gradient_2)  # -> flatten(Mesh)
pipe_6 = Pipe(Curve=brep_edges_2.Naked, Radius=Slider(0.05, range=0..0.1), Caps=0)
pipe_7 = Pipe(Curve=brep_edges_3.Naked, Radius=Slider(0.05, range=0..0.1), Caps=0)
construct_mesh_3 = ConstructMesh(Vertices=deconstruct_mesh_3.Vertices, Faces=deconstruct_mesh_3.Faces, Colours=gradient_3)  # -> flatten(Mesh)
mesh_9 = Mesh(pipe_7)
mesh_10 = Mesh(pipe_6)
mesh_11 = Mesh(pipe_5)
mesh_colours_9 = MeshColours(Mesh=mesh_9, Colours=colour_swatch_2)
mesh_colours_10 = MeshColours(Mesh=mesh_10, Colours=colour_swatch_2)
deconstruct_mesh_4 = DeconstructMesh(Mesh=cluster.geometry_2)  # -> Vertices, Faces, Colours, Normals
deconstruct_mesh_5 = DeconstructMesh(Mesh=cluster_2.geometry_2)  # -> Vertices, Faces, Colours, Normals
deconstruct_mesh_6 = DeconstructMesh(Mesh=cluster_3.geometry_2)  # -> Vertices, Faces, Colours, Normals
mesh_colours_11 = MeshColours(Mesh=mesh_11, Colours=colour_swatch_2)
point_4 = Point(deconstruct_mesh_4.Vertices)
point_5 = Point(deconstruct_mesh_5.Vertices)
point_6 = Point(deconstruct_mesh_6.Vertices)
deconstruct_4 = Deconstruct(Point=point_4)  # -> XComponent, YComponent, ZComponent
deconstruct_5 = Deconstruct(Point=point_5)  # -> XComponent, YComponent, ZComponent
deconstruct_6 = Deconstruct(Point=point_6)  # -> XComponent, YComponent, ZComponent
bounds_4 = Bounds(Numbers=deconstruct_4.ZComponent)
bounds_5 = Bounds(Numbers=deconstruct_5.ZComponent)
bounds_6 = Bounds(Numbers=deconstruct_6.ZComponent)
deconstruct_domain_4 = DeconstructDomain(Domain=bounds_4)  # -> Start, End
deconstruct_domain_5 = DeconstructDomain(Domain=bounds_5)  # -> Start, End
deconstruct_domain_6 = DeconstructDomain(Domain=bounds_6)  # -> Start, End
gradient_4 = Gradient(
    LowerLimit=deconstruct_domain_4.Start,
    UpperLimit=deconstruct_domain_4.End,
    Parameter=deconstruct_4.ZComponent,
    stops=[0.15: RGB(255, 255, 255), 0.85: RGB(223, 207, 255)])
gradient_5 = Gradient(
    LowerLimit=deconstruct_domain_5.Start,
    UpperLimit=deconstruct_domain_5.End,
    Parameter=deconstruct_5.ZComponent,
    stops=[0.15: RGB(255, 255, 255), 0.85: RGB(223, 207, 255)])
gradient_6 = Gradient(
    LowerLimit=deconstruct_domain_6.Start,
    UpperLimit=deconstruct_domain_6.End,
    Parameter=deconstruct_6.ZComponent,
    stops=[0.15: RGB(255, 255, 255), 0.85: RGB(223, 207, 255)])
construct_mesh_4 = ConstructMesh(Vertices=deconstruct_mesh_4.Vertices, Faces=deconstruct_mesh_4.Faces, Colours=gradient_4)  # -> flatten(Mesh)
construct_mesh_5 = ConstructMesh(Vertices=deconstruct_mesh_5.Vertices, Faces=deconstruct_mesh_5.Faces, Colours=gradient_5)  # -> flatten(Mesh)
construct_mesh_6 = ConstructMesh(Vertices=deconstruct_mesh_6.Vertices, Faces=deconstruct_mesh_6.Faces, Colours=gradient_6)  # -> flatten(Mesh)

# ---- group: RH_OUT:pcrv03
curve_8 = Curve(flatten([cluster.line_2, cluster.geometry_3]))

# ---- group: RH_OUT:mshright
mesh_12 = Mesh(construct_mesh)

# ---- group: RH_OUT:panelsright
mesh_13 = Mesh(construct_mesh_4)

# ---- group: RH_OUT:winright
mesh_14 = Mesh(mesh_colours_6)

# ---- group: RH_OUT:strright
mesh_15 = Mesh(mesh_colours_10)

# ---- group: RH_OUT:mshmodc
mesh_16 = Mesh(construct_mesh_2)

# ---- group: RH_OUT:panelscntr
mesh_17 = Mesh(construct_mesh_6)

# ---- group: RH_OUT:pcrv02
curve_9 = Curve([cluster_3.line_2, cluster_3.geometry_3])

# ---- group: RH_OUT:wincnt
mesh_18 = Mesh(mesh_colours_8)

# ---- group: RH_OUT:strcntr
mesh_19 = Mesh(mesh_colours_9)

# ---- group: RH_OUT:mshmodl
mesh_20 = Mesh(construct_mesh_3)

# ---- group: RH_OUT:panels
mesh_21 = Mesh(construct_mesh_5)

# ---- group: RH_OUT:strleft
mesh_22 = Mesh(mesh_colours_11)

# ---- group: RH_OUT:winleft
mesh_23 = Mesh(mesh_colours_7)

# ---- group: RH_OUT:pcrv01
curve_10 = Curve([cluster_2.line_2, cluster_2.geometry_3])

# ---- group: RH_OUT:hatch01
mesh_24 = Mesh(mesh_colours_2)

# ---- group: RH_OUT:hatch02
mesh_25 = Mesh(mesh_colours)

# ----
custom_preview_lineweights = CustomPreviewLineweights(Geometry=curve_8, Shader=ColourSwatch(SwatchColor=RGB(74, 74, 74)), Absolute=False)
custom_preview_lineweights_2 = CustomPreviewLineweights(Geometry=curve_10, Shader=ColourSwatch(SwatchColor=RGB(74, 74, 74)), Absolute=False)
custom_preview_lineweights_3 = CustomPreviewLineweights(Geometry=curve_9, Shader=ColourSwatch(SwatchColor=RGB(74, 74, 74)), Absolute=False)

# ==== cluster Cluster
A = ClusterInput()
division = Division(A=A, B=Slider(100, range=0..100))
stream = ClusterInput()
gate = ClusterInput()
panel = Panel(division)
stream_gate = StreamGate(Stream=stream, Gate=gate)  # -> Target0, Target1
geometry = ClusterInput()
subd_from_mesh = SubDFromMesh(Mesh=stream_gate.Target1, Creases=1, Corners=1, Interpolate=False)
area = Area(Geometry=geometry)  # -> Area, Centroid
deconstruct_brep = DeconstructBrep(Brep=subd_from_mesh)  # -> Faces, Edges, Vertices
construct_domain = ConstructDomain(DomainStart=Slider(0, range=0..100), DomainEnd=Slider(40, range=0..100))
steps = ClusterInput()
range = Range(Domain=construct_domain, Steps=steps)
random = Random(Range=range, Number=1, Seed=2)
panel_2 = Panel("""0
1
2
3
4""")
absolute = Absolute(Value=flatten(random))
list_item = ListItem(List=deconstruct_brep.Faces, Index=absolute, Wrap=True)
panel_3 = Panel(range)
panel_4 = Panel(absolute)
scale = Scale(Geometry=list_item, Center=area.Centroid, Factor=division)  # -> Geometry, Transform
scale_2 = Scale(Geometry=deconstruct_brep.Edges, Center=area.Centroid, Factor=division)  # -> Geometry, Transform
geometry_2 = ClusterOutput(scale.Geometry)
area_2 = Area(Geometry=list_item)  # -> Area, Centroid
area_3 = Area(Geometry=scale.Geometry)  # -> Area, Centroid
geometry_3 = ClusterOutput(scale_2.Geometry)
line = Line(StartPoint=area_3.Centroid, EndPoint=area_2.Centroid)
line_2 = ClusterOutput(line)
